# Grasshopper definition DiTWP_UE_W24VZ_2310326048_Grasshopper.gh (Grasshopper 1.0.8)
# plug-ins: sof_gh_sofistik-2024, Speckle 2, CORE.Toolbox.Grasshopper

io = IO(
    SofistikDocumentProperties_Settings="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",
    SofistikDocumentProperties_VersionMajor="2024",
    SofistikDocumentProperties_VersionMinor="7",
    SofistikDocumentProperties_VersionName="2024")

winkel_strebe = Slider(10, range=10..40)
z_höhe_strebe_gem_angabe = Panel("40")
breite_querschnitt_gem_angabe = Panel("1")
länge_oberbau_gem_angabe = Panel("40\t")
# max Länge 44,72 m somit max Winkel 26,56 Grad, sonst kreuzen sich die 2 Streben
panel = Panel("-40")
radians = Radians(Degrees=winkel_strebe)
cosine = Cosine(Value=radians)
division = Division(A=z_höhe_strebe_gem_angabe, B=cosine)
länge_der_strebe = Panel(division)
breite_qs = Number(breite_querschnitt_gem_angabe)
länge_strebe = Number(division)
division_2 = Division(A=länge_strebe, B="20")
länge_platte = Number(länge_oberbau_gem_angabe)
h_der_strebe_qs = Number(division_2)
panel_2 = Panel(h_der_strebe_qs)
addition = Addition(A=h_der_strebe_qs, B=panel)
höhe_platte = Number(panel_2)

platte = Curve(<curve referenced from the Rhino model>)
deconstruct_brep = DeconstructBrep(Brep=platte)  # -> Faces, Edges, Vertices
list_length = ListLength(List=deconstruct_brep.Vertices)
panel_3 = Panel("0")
series = Series(Start=panel_3, Step="1", Count=list_length)
deconstruct = Deconstruct(Point=deconstruct_brep.Vertices)  # -> XComponent, YComponent, ZComponent
text_tag = TextTag(Location=deconstruct_brep.Vertices, Text=series)
panel_4 = Panel("""0
1""")
panel_5 = Panel("""0
3""")
replace_items = ReplaceItems(List=deconstruct.XComponent, Item="0", Indices=panel_5, Wrap=False)
replace_items_2 = ReplaceItems(List=deconstruct.ZComponent, Item="0", Indices=panel_4, Wrap=False)
panel_6 = Panel("""1
2""")
panel_7 = Panel("""2
3""")
panel_8 = Panel(replace_items)
replace_items_3 = ReplaceItems(List=replace_items, Item=länge_platte, Indices=panel_6, Wrap=False)
panel_9 = Panel(replace_items_2)
replace_items_4 = ReplaceItems(List=replace_items_2, Item=höhe_platte, Indices=panel_7, Wrap=False)
panel_10 = Panel(replace_items_4)
panel_11 = Panel(replace_items_3)
construct_point = ConstructPoint(XCoordinate=replace_items_3, YCoordinate=0, ZCoordinate=replace_items_4)
shift_list = ShiftList(List=construct_point, Shift="1", Wrap=True)
panel_12 = Panel(shift_list)
line = Line(StartPoint=construct_point, EndPoint=shift_list)
# Platte
boundary_surfaces = BoundarySurfaces(Edges=line)

panel_13 = Panel("https://app.speckle.systems/projects/eb962d0968/models/16147769b8")
receive = Receive(
    Stream=panel_13,
    AutoReceive=False,
    CurrentComponentState="up_to_date",
    ExpandOutput=True,
    LastInfoMessage="Gabor Toth @ 01/08/2025 18:19:52: Daten für Excel (id:4e30826fcc)",
    ReceiveOnOpen=False,
    ReceivedCommitId="4e30826fcc",
    StreamWrapper="https://app.speckle.systems/projects/eb962d0968/models/abgabe_toth",
    selectedKitName="Objects")  # -> Info, Data
panel_14 = Panel(receive.Info)
panel_15 = Panel(receive.Data)
panel_16 = Panel("""0
9
10
14
20
21
25
26""")
panel_17 = Panel("""4
6
18""")
list_item = ListItem(List=receive.Data, Index=panel_16, Wrap=True)
list_item_2 = ListItem(List=receive.Data, Index=panel_17, Wrap=True)
panel_18 = Panel(list_item_2)
point = Point(list_item)
panel_19 = Panel(point)
line_2 = Line(list_item_2)
list_length_2 = ListLength(List=point)
list_length_3 = ListLength(List=line_2)
# Sofistik
panel_20 = Panel("1")
series_2 = Series(Start="1", Step=panel_20, Count=list_length_2)
series_3 = Series(Start="101", Step="1", Count=list_length_3)
panel_21 = Panel(series_2)
panel_22 = Panel(series_3)
panel_23 = Panel("""PZ
PZ

F

F""")
text_tag_2 = TextTag(Text=series_3, Colour=ColourSwatch(SwatchColor=RGB(111, 21, 237)))
structural_point = StructuralPoint(Point=point, SptID=series_2, Fixation=panel_23)
text_tag_3 = TextTag(Location=point, Text=series_2, Colour=ColourSwatch(SwatchColor=RGB(255, 156, 25)))
panel_24 = Panel("""1
2
2""")
structural_line = StructuralLine(Curve=line_2, SlnID=series_3, Group="1", Section=panel_24, ElementType="From Section", FESize=0)
list_item_3 = ListItem(List=structural_point, Index="3", Wrap=True)
list_item_4 = ListItem(List=structural_point, Index="5", Wrap=True)
list_item_5 = ListItem(List=structural_point, Index="0", Wrap=True)
list_item_6 = ListItem(List=structural_point, Index="6", Wrap=True)
rigid_link = RigidLink(AGeometry=list_item_5, BGeometry=list_item_6, Group=0, Fixation="F")
rigid_link_2 = RigidLink(AGeometry=list_item_3, BGeometry=list_item_4, Group=0, Fixation="F")
data = Data([rigid_link_2, rigid_link, structural_point, structural_line])
sofimshc = SOFiMSHC(
    StructuralElements=data,
    InitSystem=True,
    MeshSize="1",
    StartIndex=1000,
    GroupDivisor=-1000,
    Interpolate=True,
    Header="Model")  # -> TextInput, Log
panel_25 = Panel(sofimshc.TextInput)
text_file = TextFile(TextInput=sofimshc.TextInput, FilePath="C:\Users\gabor.toth\DiTWP_Übung\sofimshc.dat", SOF_STREAM_CONTENT=True)

# ----
# Excel Querschnitte
panel_26 = Panel([höhe_platte, breite_qs, h_der_strebe_qs])

concatenate = Concatenate(FragmentA="C:\Users\gabor.toth\DiTWP_Übung", FragmentB="DiTWP_UE_W24VZ_2310326048_Excel.xlsx")
panel_27 = Panel(concatenate)
write_to_excel_classic = WriteToExcelClassic(
    WorkbookFilepath=concatenate,
    WorksheetName="QS",
    Data=panel_26,
    LocationAddress="A1",
    Clear=Toggle(False),
    Stream=Toggle(False))

panel_28 = Panel("C:\Users\gabor.toth\DiTWP_Übung\DiTWP_UE_W24VZ_2310326048_Excel.xlsx")
panel_29 = Panel("C:\Users\gabor.toth\DiTWP_Übung\DiTWP_UE_W24VZ_2310326048_Excel.xlsx")
line_3 = Line(line_2)
panel_30 = Panel(line_3)
panel_31 = Panel(write_to_excel_classic)
list_item_7 = ListItem(List=line_3, Index="1", Wrap=True)
list_item_8 = ListItem(List=line_3, Index="1", Wrap=True)
panel_32 = Panel("""G
G1
Q
Q1""")
panel_33 = Panel("""1
0
0
0""")
panel_34 = Panel("""10
20
30
40""")
panel_35 = Panel("""EGW
Aufbau
Verkehr punktuell
Verkehr Linienlast""")

streben = Curve(<curve referenced from the Rhino model>)
deconstruct_brep_2 = DeconstructBrep(Brep=streben)  # -> Faces, Edges, Vertices
panel_36 = Panel("""0
3""")
panel_37 = Panel("""0
1""")
replace_items_5 = ReplaceItems(List=deconstruct_brep_2.Vertices, Item="0", Indices=panel_36, Wrap=False)
replace_items_6 = ReplaceItems(List=deconstruct.ZComponent, Item="-40", Indices=panel_37, Wrap=False)
panel_38 = Panel(replace_items_5)
panel_39 = Panel(replace_items_6)
panel_40 = Panel("""1
2""")
panel_41 = Panel("""2
3""")
replace_items_7 = ReplaceItems(List=replace_items_6, Item=addition, Indices=panel_41, Wrap=False)
replace_items_8 = ReplaceItems(List=replace_items_5, Item=länge_strebe, Indices=panel_40, Wrap=False)
panel_42 = Panel(replace_items_7)
panel_43 = Panel(replace_items_8)
construct_point_2 = ConstructPoint(XCoordinate=replace_items_8, YCoordinate=0, ZCoordinate=replace_items_7)
shift_list_2 = ShiftList(List=construct_point_2, Shift="1", Wrap=True)
line_4 = Line(StartPoint=construct_point_2, EndPoint=shift_list_2)
panel_44 = Panel(shift_list_2)
boundary_surfaces_2 = BoundarySurfaces(Edges=line_4)
unit_y = UnitY(Factor=1)

deconstruct_brep_3 = DeconstructBrep(Brep=streben)  # -> Faces, Edges, Vertices
subtraction = Subtraction(A="40", B=länge_strebe)
panel_45 = Panel("""0
3""")
panel_46 = Panel("""1
2""")
replace_items_9 = ReplaceItems(List=deconstruct_brep_3.Vertices, Item=subtraction, Indices=panel_45, Wrap=False)
replace_items_10 = ReplaceItems(List=replace_items_9, Item="40", Indices=panel_46, Wrap=False)
panel_47 = Panel(replace_items_9)
panel_48 = Panel(replace_items_10)
panel_49 = Panel("""0
1""")
panel_50 = Panel("""2
3""")
replace_items_11 = ReplaceItems(List=deconstruct.ZComponent, Item="-40", Indices=panel_49, Wrap=False)
replace_items_12 = ReplaceItems(List=replace_items_11, Item=addition, Indices=panel_50, Wrap=False)
panel_51 = Panel(replace_items_11)
panel_52 = Panel(replace_items_12)
construct_point_3 = ConstructPoint(XCoordinate=replace_items_10, YCoordinate=0, ZCoordinate=replace_items_12)
shift_list_3 = ShiftList(List=construct_point_3, Shift="1", Wrap=True)
panel_53 = Panel(shift_list_3)
line_5 = Line(StartPoint=construct_point_3, EndPoint=shift_list_3)
# Strebe 1
# Strebe 2
boundary_surfaces_3 = BoundarySurfaces(Edges=line_5)

list_length_4 = ListLength(List=[deconstruct_brep_2.Vertices, deconstruct_brep_3.Vertices, construct_point_3])
panel_54 = Panel("0")
series_4 = Series(Start=panel_54, Step="1", Count=list_length_4)
# Nummerierung
colour_swatch = ColourSwatch(SwatchColor=RGB(0, 211, 222))
text_tag_4 = TextTag(Location=deconstruct_brep_2.Vertices, Text=series_4, Colour=colour_swatch)

# ----
# Verdrehen der Streben
panel_55 = Panel("270")
unit_y_2 = UnitY(Factor=1)
unit_y_3 = UnitY(Factor=breite_qs)
subtraction_2 = Subtraction(A="90", B=winkel_strebe)
addition_2 = Addition(A=panel_55, B=winkel_strebe)
radians_2 = Radians(Degrees=subtraction_2)
rotate_3d = Rotate3D(Geometry=boundary_surfaces_3, Angle=radians_2, Center="40,0,-40", Axis=unit_y_2)  # -> Geometry, Transform
radians_3 = Radians(Degrees=addition_2)

rotate_3d_2 = Rotate3D(Geometry=boundary_surfaces_2, Angle=radians_3, Center="0,0,-40", Axis=unit_y)  # -> Geometry, Transform

unit_y_4 = UnitY(Factor=breite_qs)
unit_y_5 = UnitY(Factor=breite_qs)
unit_y_6 = UnitY(Factor=breite_qs)
extrude = Extrude(Base=boundary_surfaces, Direction=unit_y_6)
extrude_2 = Extrude(Base=rotate_3d_2.Geometry, Direction=unit_y_5)
extrude_3 = Extrude(Base=rotate_3d.Geometry, Direction=unit_y_4)
# Extrudieren
brep = Brep(flatten([extrude, extrude_2, extrude_3]))
panel_56 = Panel(brep)

list_item_9 = ListItem(List=brep, Index="1", Wrap=True)
deconstruct_brep_4 = DeconstructBrep(Brep=list_item_9)  # -> Faces, Edges, Vertices
panel_57 = Panel(deconstruct_brep_4.Faces)
list_item_10 = ListItem(List=deconstruct_brep_4.Faces, Index=Slider(1, range=0..5), Wrap=True)
list_item_11 = ListItem(List=deconstruct_brep_4.Faces, Index=Slider(3, range=0..5), Wrap=True)
area = Area(Geometry=list_item_10)  # -> Area, Centroid
area_2 = Area(Geometry=list_item_11)  # -> Area, Centroid
line_6 = Line(StartPoint=area.Centroid, EndPoint=area_2.Centroid)
explode = Explode(Curve=line_6, Recursive=True)  # -> flatten(Segments), flatten(Vertices)
panel_58 = Panel(explode.Segments)
panel_59 = Panel(explode.Vertices)
list_item_12 = ListItem(List=explode.Segments, Index="0", Wrap=True)
list_item_13 = ListItem(List=explode.Segments, Index="1", Wrap=True)
linie_2 = Line(list_item_13)
linie_1 = Line(list_item_12)
line_7 = Line([linie_1, linie_2])
line_line = LineLine(Line1=linie_1, Line2=linie_2)  # -> ParamA, ParamB, PointA, PointB
point_2 = Point([explode.Vertices, line_line.PointB])
panel_60 = Panel(point_2)

list_item_14 = ListItem(List=brep, Index="0", Wrap=True)
deconstruct_brep_5 = DeconstructBrep(Brep=list_item_14)  # -> Faces, Edges, Vertices
list_item_15 = ListItem(List=deconstruct_brep_5.Faces, Index=Slider(3, range=0..5), Wrap=True)
list_item_16 = ListItem(List=deconstruct_brep_5.Faces, Index=Slider(1, range=0..5), Wrap=True)
area_3 = Area(Geometry=list_item_15)  # -> Area, Centroid
area_4 = Area(Geometry=list_item_16)  # -> Area, Centroid
line_8 = Line(StartPoint=area_4.Centroid, EndPoint=area_3.Centroid)
explode_2 = Explode(Curve=line_8, Recursive=True)  # -> flatten(Segments), flatten(Vertices)
panel_61 = Panel(explode_2.Vertices)
panel_62 = Panel(explode_2.Segments)
list_item_17 = ListItem(List=explode_2.Segments, Index="1", Wrap=True)
list_item_18 = ListItem(List=explode_2.Segments, Index="0", Wrap=True)
linie_2_2 = Line(list_item_17)
linie_1_2 = Line(list_item_18)
# Schwerpunktlinie- Platte
line_line_2 = LineLine(Line1=linie_1_2, Line2=linie_2_2)  # -> ParamA, ParamB, PointA, PointB
point_3 = Point([explode_2.Vertices, line_line_2.PointB])
panel_63 = Panel(point_3)
line_9 = Line([linie_1_2, linie_2_2])
point_4 = Point([line_line_2.PointA, explode_2.Vertices])
panel_64 = Panel(point_4)

list_item_19 = ListItem(List=brep, Index="2", Wrap=True)
deconstruct_brep_6 = DeconstructBrep(Brep=list_item_19)  # -> Faces, Edges, Vertices
panel_65 = Panel(deconstruct_brep_6.Faces)
list_item_20 = ListItem(List=deconstruct_brep_6.Faces, Index=Slider(1, range=0..5), Wrap=True)
list_item_21 = ListItem(List=deconstruct_brep_6.Faces, Index=Slider(3, range=0..5), Wrap=True)
area_5 = Area(Geometry=list_item_20)  # -> Area, Centroid
area_6 = Area(Geometry=list_item_21)  # -> Area, Centroid
line_10 = Line(StartPoint=area_5.Centroid, EndPoint=area_6.Centroid)
explode_3 = Explode(Curve=line_10, Recursive=True)  # -> flatten(Segments), flatten(Vertices)
panel_66 = Panel(explode_3.Vertices)
panel_67 = Panel(explode_3.Segments)
list_item_22 = ListItem(List=explode_3.Segments, Index="0", Wrap=True)
list_item_23 = ListItem(List=explode_3.Segments, Index="1", Wrap=True)
linie_2_3 = Line(list_item_23)
linie_1_3 = Line(list_item_22)
line_line_3 = LineLine(Line1=linie_1_3, Line2=linie_2_3)  # -> ParamA, ParamB, PointA, PointB
line_11 = Line([linie_1_3, linie_2_3])
point_5 = Point([explode_3.Vertices, line_line_3.PointB])
panel_68 = Panel(point_5)

data_2 = Data(extrude)
panel_69 = Panel("https://app.speckle.systems/projects/5b87606e95/models/fea7eabe47")
send = Send(
    Stream=panel_69,
    Message="Linien und Punkte",
    Data=data_2,
    AutoSend=False,
    BaseId="2c0c66f76ddacf9b27e3ff5ec387db22",
    CurrentComponentState="expired",
    KitName="Objects",
    OutputWrappers="https://app.speckle.systems\t5b87606e95\tfb42289c03",
    UseDefaultCache=True,
    selectedKitName="Objects")

panel_70 = Panel(deconstruct_brep_5.Faces)

# ----
# 3D Ausgabe
export_3dm = Export3DM(
    Geometries=brep,
    DirectoryPath="C:\Users\gabor.toth\DiTWP_Übung",
    FileName="DiTWP_UE_W24VZ_2310326048_3D_Bake",
    Units=4,
    Version=7,
    Save=Toggle(True))

deconstruct_brep_7 = DeconstructBrep(Brep=extrude)  # -> Faces, Edges, flatten(Vertices)
panel_71 = Panel(deconstruct_brep_7.Vertices)
fit_line = FitLine(Points=deconstruct_brep_7.Vertices)
panel_72 = Panel(fit_line)
explode_4 = Explode(Curve=fit_line, Recursive=True)  # -> flatten(Segments), flatten(Vertices)
panel_73 = Panel(explode_4.Vertices)
panel_74 = Panel(explode_4.Segments)
list_item_24 = ListItem(List=explode_4.Segments, Index="0", Wrap=True)
list_item_25 = ListItem(List=explode_4.Segments, Index="1", Wrap=True)
linie_1_4 = Line(list_item_24)
linie_2_4 = Line(list_item_25)
line_line_4 = LineLine(Line1=list_item_24, Line2=linie_2_4)  # -> ParamA, ParamB, PointA, PointB
line_12 = Line([linie_1_4, linie_2_4])
point_6 = Point([line_line_4.PointA, explode_4.Vertices])
panel_75 = Panel(point_6)
point_7 = Point([explode_4.Vertices, line_line_4.PointB])
panel_76 = Panel(point_7)
panel_77 = Panel("https://app.speckle.systems/projects/5b87606e95/models/fea7eabe47")
data_3 = Data([line_12, point_6, point_7])
send_2 = Send(
    Stream=panel_77,
    Message="Linien und Punkte",
    Data=data_3,
    AutoSend=False,
    BaseId="4d426ecdcecf6f267bad4c2f426201c2",
    CurrentComponentState="expired",
    KitName="Objects",
    OutputWrappers="https://app.speckle.systems\t5b87606e95\tf26777754a",
    UseDefaultCache=True,
    selectedKitName="Objects")

point_8 = Point(line_line_3.PointA)
point_9 = Point(line_line.PointA)
line_line_5 = LineLine(Line1=line_11, Line2=line_9)  # -> ParamA, ParamB, PointA, PointB
data_4 = Data([line_9, point_4, point_3, line_7, point_2])

panel_78 = Panel("https://app.speckle.systems/projects/eb962d0968/models/16147769b8")
line_line_6 = LineLine(Line1=line_7, Line2=line_9)  # -> ParamA, ParamB, PointA, PointB
data_5 = Data([line_line_6.PointA, line_line_6.PointB, line_7, line_9, point_4, point_3, line_line_5.PointA, line_line_5.PointB, line_11, point_5, point_8, point_9, point_2])
# Speckle
send_3 = Send(
    Stream=panel_78,
    Message="Linien und Punkte",
    Data=data_5,
    AutoSend=False,
    BaseId="2647490b35176fabee74f5ae73655f6b",
    CurrentComponentState="expired",
    KitName="Objects",
    OutputWrappers="https://app.speckle.systems\teb962d0968\t38b35f6673",
    UseDefaultCache=True,
    selectedKitName="Objects")

panel_79 = Panel("https://app.speckle.systems/projects/eb962d0968/models/16147769b8")
send_4 = Send(
    Stream=panel_79,
    Message="Daten für Excel",
    Data=data_5,
    AutoSend=False,
    BaseId="2647490b35176fabee74f5ae73655f6b",
    CurrentComponentState="expired",
    KitName="Objects",
    OutputWrappers="https://app.speckle.systems\teb962d0968\t4e30826fcc",
    UseDefaultCache=True,
    selectedKitName="Objects")
# Excel für Speckle
panel_80 = Panel(send_4)

concatenate_2 = Concatenate(FragmentA="C:\Users\gabor.toth\DiTWP_Übung\", FragmentB="DiTWP_UE_W24VZ_2310326048_Excel.xlsx")
# Excel
panel_81 = Panel(concatenate_2)
write_to_excel_classic_2 = WriteToExcelClassic(
    WorkbookFilepath=panel_28,
    WorksheetName="Tabelle1",
    Data=data_3,
    LocationAddress="A1",
    Clear=Toggle(False),
    Stream=Toggle(False))

panel_82 = Panel(write_to_excel_classic_2)

wichte_stb = Panel("25")
panel_83 = Panel("""0
1
2""")
negative = Negative(Value="300")
negative_2 = Negative(Value="3.36")
negative_3 = Negative(Value="9")
multiplication = Multiplication(A=höhe_platte, B=wichte_stb)
negative_4 = Negative(Value=multiplication)
line_13 = Line(list_item_7)
unit_z = UnitZ(Factor=negative)
unit_z_2 = UnitZ(Factor=negative_2)
unit_z_3 = UnitZ(Factor=negative_3)
line_14 = Line(list_item_8)
unit_z_4 = UnitZ(Factor=negative_4)
# Verkehrslast Punktlast
# Verkehrslast Linienlast
line_load = LineLoad(CurveSln=line_13, Loadcase="40", Force=unit_z_3, Moment=Vector(0, 0, 0), HostLocal=False)
# Eigengewicht
line_load_2 = LineLoad(CurveSln=line_14, Loadcase="20", Force=unit_z_2, Moment=Vector(0, 0, 0), HostLocal=False)
loadcase_attributes = LoadcaseAttributes(Loadcase=panel_34, Action=panel_32, FacDeadload=panel_33, Title=panel_35)

division_3 = Division(A=höhe_platte, B="2")
list_item_26 = ListItem(List=line_3, Index=panel_83, Wrap=True)

construct_point_4 = ConstructPoint(XCoordinate="20", YCoordinate="0.5", ZCoordinate=division_3)
point_10 = Point(construct_point_4)
line_15 = Line(list_item_26)
# Ausbaulast
point_load = PointLoad(
    PointSpt=point_10,
    Loadcase="30",
    Force=unit_z,
    Moment=Vector(0, 0, 0),
    Displacement=Vector(0, 0, 0),
    RotDispl=Vector(0, 0, 0),
    HostLocal=False)
line_load_3 = LineLoad(CurveSln=line_15, Loadcase="10", Force=Vector(0, 0, 0), Moment=Vector(0, 0, 0), HostLocal=False)

sofiload = SOFiLOAD(Loads=[line_load_3, line_load_2, point_load, line_load], LCAttributes=loadcase_attributes)  # -> TextInput, Log
panel_84 = Panel(sofiload.TextInput)
ase = ASE(Loadcase=panel_34, Threads=-1, Header="Berechnung")  # -> TextInput, Log
text_file_2 = TextFile(TextInput=sofiload.TextInput, FilePath="C:\Users\gabor.toth\DiTWP_Übung\Sofiload.dat", SOF_STREAM_CONTENT=True)
text_file_3 = TextFile(TextInput=ase.TextInput, FilePath="C:\Users\gabor.toth\DiTWP_Übung\ase.dat", SOF_STREAM_CONTENT=True)
panel_85 = Panel(ase.TextInput)
